# Grasshopper definition EvolutiveCocoon2.gh (Grasshopper 1.0.7)
# plug-ins: MarchingCubes

pt = Point([Point(41.89145703, 54.45761393, 0), Point(63.77380753, -18.70903505, 0), Point(-25.62441494, -18.11760292, 0), Point(16.73241539, 16.51440321, 0), Point(3.937185556, 48.23323292, 0)])
scale = Panel("0.1")
points = GetPoint(pt, AtLeast=1, AtMost=2147483647, Realtime=True)
dimension = GetNumber(Slider(650, range=350..1000), AtLeast=1, AtMost=2147483647, Maximum=1.797693135e+308, Minimum=-1.797693135e+308)
unit_z = UnitZ(Factor="110")
dom = ConstructDomain(DomainStart=expr("-x/2", dimension), DomainEnd=expr("x/2", dimension))
move = Move(Geometry=points, Motion=unit_z)  # -> Geometry, Transform
rectangle = Rectangle(Plane=PlaneXY(0, 0, 0), XSize=dom, YSize=dom, Radius=0)  # -> Rectangle, Length

# ---- group: RH_IN:SUNLIGHT ANALYSIS
bool = Boolean(False)

# ----
list_item = ListItem(List=move.Geometry, Index=0, Wrap=True)  # -> Item, Item1, Item2, Item3, Item4
pt_2 = Point(list_item.Item1)
pt_3 = Point(list_item.Item)
pt_4 = Point(list_item.Item2)
pt_5 = Point(list_item.Item3)
pt_6 = Point(list_item.Item4)
get_string = GetString("POINT 1", AtLeast=1, AtMost=2147483647)
get_string_2 = GetString("POINT 2", AtLeast=1, AtMost=2147483647)
get_string_3 = GetString("POINT 3", AtLeast=1, AtMost=2147483647)
get_string_4 = GetString("POINT 4", AtLeast=1, AtMost=2147483647)
get_string_5 = GetString("POINT 5", AtLeast=1, AtMost=2147483647)
bool_2 = Boolean(True)
c_script = CSharpScript(face="Verdana", bold=bool_2, size="10", content=get_string, pl=pt_3)  # -> out, A; inputs face: String, bold: Boolean, italics: Boolean, size: Double, content: String, pl: Plane
# ---------- c_script: C# usings ----------
using System.IO;
using System.Linq;
using System.Data;
using System.Drawing;
using System.Reflection;
using System.Windows.Forms;
using System.Xml;
using System.Xml.Linq;
using System.Runtime.InteropServices;

using Rhino.DocObjects;
using Rhino.Collections;
using GH_IO;
using GH_IO.Serialization;
# ---------- c_script: C# ----------
    if(size == 0)
      size = 1;

    if(!string.IsNullOrEmpty(face) && size > 0 && !string.IsNullOrEmpty(content) &&
      pl.IsValid)
    {
      using (var doc = Rhino.RhinoDoc.CreateHeadless(null))
      {
        var te = doc.Objects.AddText(content, pl, size, face, bold, italics);
        var txt = doc.Objects.Find(te) as Rhino.DocObjects.TextObject;

        if(txt != null)
        {
          var tt = txt.Geometry as Rhino.Geometry.TextEntity;
          A = tt.Explode();
        }
      }
    }
# ---------- end c_script ----------
c_script_2 = CSharpScript(face="Verdana", bold=bool_2, size="10", content=get_string_2, pl=pt_2)  # -> out, A; inputs face: String, bold: Boolean, italics: Boolean, size: Double, content: String, pl: Plane; same code as c_script
c_script_3 = CSharpScript(face="Verdana", bold=bool_2, size="10", content=get_string_3, pl=pt_4)  # -> out, A; inputs face: String, bold: Boolean, italics: Boolean, size: Double, content: String, pl: Plane; same code as c_script
c_script_4 = CSharpScript(face="Verdana", bold=bool_2, size="10", content=get_string_4, pl=pt_5)  # -> out, A; inputs face: String, bold: Boolean, italics: Boolean, size: Double, content: String, pl: Plane; same code as c_script
c_script_5 = CSharpScript(face="Verdana", bold=bool_2, size="10", content=get_string_5, pl=pt_6)  # -> out, A; inputs face: String, bold: Boolean, italics: Boolean, size: Double, content: String, pl: Plane; same code as c_script

# ---- group: RH_OUT:limit
crv = Curve(rectangle.Rectangle)

# ----
scale_2 = Scale(Geometry=points, Center=Point(0, 0, 0), Factor=scale)  # -> Geometry, Transform
sp_radius2 = GetNumber(Slider(77, range=25..100), AtLeast=1, AtMost=2147483647, Maximum=1.797693135e+308, Minimum=-1.797693135e+308)
sp_radius3 = GetNumber(Slider(25, range=25..100), AtLeast=1, AtMost=2147483647, Maximum=1.797693135e+308, Minimum=-1.797693135e+308)
sp_radius1 = GetNumber(Slider(61, range=25..100), AtLeast=1, AtMost=2147483647, Maximum=1.797693135e+308, Minimum=-1.797693135e+308)  # disabled
sp_radius4 = GetNumber(Slider(100, range=25..100), AtLeast=1, AtMost=2147483647, Maximum=1.797693135e+308, Minimum=-1.797693135e+308)
sp_radius5 = GetNumber(Slider(91, range=25..100), AtLeast=1, AtMost=2147483647, Maximum=1.797693135e+308, Minimum=-1.797693135e+308)
merge = Merge(Data1=sp_radius1, Data2=sp_radius2, Data3=sp_radius3, Data4=sp_radius4, Data5=sp_radius5)

panel = Panel("TEXT TO CURVE")

point_charge = PointCharge(Point=points, Radius=merge, ChargeStrength=1)
boolean_toggle = BooleanToggle(True)
cocoon = Cocoon(Charges=point_charge, Iso="0.02", CellSize="20", Execute=boolean_toggle, Simple=False)  # -> Mesh, RefinementData
panel_2 = Panel("GENERATE COCOON")

# ---- group: RH_OUT:text_lines1
crv_2 = Curve(c_script.A)

# ---- group: RH_OUT:text_lines2
crv_3 = Curve(c_script_2.A)

# ---- group: RH_OUT:text_lines3
crv_4 = Curve(c_script_3.A)

# ---- group: RH_OUT:text_lines4
crv_5 = Curve(c_script_4.A)

# ---- group: RH_OUT:text_lines5
crv_6 = Curve(c_script_5.A)

# ----
multiplication = Multiplication(A="20", B="3")
refine = Refine(
    RefinementData=cocoon.RefinementData,
    Samples=multiplication,
    SampleSize="30",
    SampleTolerance="0.01",
    LaplacianSmoothing="10",
    ValencePasses="10",
    SubD="1",
    Execute=boolean_toggle)

mesh = Mesh(refine)
box = Box(mesh)
deconstruct_brep = DeconstructBrep(Brep=box)  # -> Faces, Edges, Vertices
list_item_2 = ListItem(List=reverse(deconstruct_brep.Faces), Index=0, Wrap=True)
list_item_3 = ListItem(List=reverse(deconstruct_brep.Edges), Index=0, Wrap=True)
length = Length(Curve=list_item_3)
# CUTTING SPHERE IN HALF
division = Division(A=length, B=2)
unit_z_2 = UnitZ(Factor=division)
negative = Negative(Value=unit_z_2)
unit_z_3 = UnitZ(Factor="50")
move_2 = Move(Geometry=list_item_2, Motion=negative)  # -> Geometry, Transform

mesh_split_plane = MeshSplitPlane(Mesh=mesh, Plane=move_2.Geometry)  # -> Above, Below
mesh_2 = Mesh(mesh_split_plane.Above)

# ---- group: Center point
bounding_box = BoundingBox(Content=flatten(mesh_2), Plane=PlaneXY(0, 0, 0), UnionBox=True)  # -> Box, Box_2
area = Area(Geometry=bounding_box.Box)  # -> Area, Centroid
point = Point(area.Centroid)

# ----
face_boundaries = FaceBoundaries(Mesh=mesh_2)
function2 = Panel("SUN HOUR ANALYSIS")

crv_7 = Curve(simplify(face_boundaries))
midpt = CurveMiddle(Curve=crv_7)
pdecon = Deconstruct(Point=midpt)  # -> XComponent, YComponent, ZComponent
bnd = Bounds(Numbers=pdecon.ZComponent)
dedomain = DeconstructDomain(Domain=bnd)  # -> Start, End
gradient = Gradient(
    LowerLimit=0,
    UpperLimit=dedomain.End,
    Parameter=pdecon.ZComponent,
    stops=[0.125: RGB(0, 0, 0), 0.499: RGB(154, 205, 50), 0.926: RGB(220, 20, 60)])
c_script_6 = CSharpScript(crv=crv_7, color=gradient)  # -> out, A; inputs crv: Curve, color: Color
# ---------- c_script_6: C# ----------
    var c = color.R + "," + color.G + "," + color.B;
    crv.SetUserString("color", c);
    A = crv;
# ---------- end c_script_6 ----------
preview = CustomPreview(Geometry=crv_7, Material=gradient)

function_1 = Panel("OUTPUT COLORED CURVE ")
gate_not = GateNot(A=bool)
curve = Curve(c_script_6.A)
unit_y = UnitY(Factor=Slider(9, range=0..10))
split_list = SplitList(List=curve, Index="0")  # -> ListA, ListB
stream_filter = StreamFilter(Gate=bool, Stream0=split_list.ListA, Stream1=split_list.ListB)

# ---- group: RH_OUT:crvs
crv_8 = Curve(stream_filter)

# ----
angle_of_sun_rays = Panel("-1.5")
number_of_sun_vectors = Panel("12")
unit_y_2 = UnitY(Factor=1)
unit_x = UnitX(Factor=1)
number_slider = Slider(100000, range=0..100000)
rotate = Rotate(Vector=unit_x, Axis=unit_y_2, Angle=degrees(angle_of_sun_rays))
line_sdl = LineSDL(Start=point, Direction=rotate, Length=Slider(289060, range=0..1000000))
range = Range(Domain="0 to 2", Steps=number_of_sun_vectors)
pi = Pi(Factor=range)
number_slider_2 = Slider(0, range=0..10)
rotate_2 = Rotate(Geometry=line_sdl, Angle=pi, Plane=PlaneXY(0, 0, 0))  # -> Geometry, Transform
end_points = EndPoints(Curve=rotate_2.Geometry)  # -> Start, End
cull_index = CullIndex(
    List=rotate_2.Geometry,
    Indices=[Slider(1, range=0..10), Slider(8, range=0..10), Slider(9, range=0..10), Slider(10, range=0..10), Slider(12, range=0..20)],
    Wrap=True)
list_item_4 = ListItem(List=end_points.End, Index="1", Wrap=True)
cull_index_2 = CullIndex(List=cull_index, Indices=Slider(10, range=0..10), Wrap=True)
end_points_2 = EndPoints(Curve=cull_index_2)  # -> Start, End
circle = Circle(Plane=end_points_2.End, Radius=Slider(10000, range=0..10000))
surface = Surface(circle)
custom_preview = CustomPreview(Geometry=cull_index_2, Material=ColourSwatch(SwatchColor=RGB(255, 255, 255)))
vector_2pt = Vector2Pt(PointA=end_points_2.End, PointB=end_points_2.Start, Unitize=False)  # -> Vector, Length
custom_preview_2 = CustomPreview(Geometry=surface, Material=ColourSwatch(SwatchColor=RGB(255, 251, 0)))
panel_3 = Panel("1000")

directsunhours = LBDirectSunHours(
    vectors=flatten(vector_2pt.Vector),
    timestep="1",
    geometry=flatten(mesh_2),
    grid_size="1000",
    offset_dist="1000000",
    parallel=Toggle(True),
    run=Toggle(True))  # -> out, points, results, mesh, legend, title, int_mtx; plug-in component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

data = Data(directsunhours.mesh)
data_2 = Data(directsunhours.legend)

split_list_2 = SplitList(List=data_2, Index="1")  # -> ListA, ListB
face_boundaries_2 = FaceBoundaries(Mesh=split_list_2.ListA)
list_item_5 = ListItem(List=face_boundaries_2, Index=Slider(10, range=0..100), Wrap=True)
area_2 = Area(Geometry=face_boundaries_2)  # -> Area, Centroid
curve_middle = CurveMiddle(Curve=list_item_5)
split_list_3 = SplitList(List=split_list_2.ListB, Index="1")  # -> ListA, ListB
move_3 = Move(Geometry=curve_middle, Motion=unit_y)  # -> Geometry, Transform
panel_4 = Panel(split_list_2.ListB)

bool_3 = Boolean(True)
get_string_6 = GetString(split_list_3.ListB, AtLeast=1, AtMost=2147483647)
c_script_7 = CSharpScript(face="Verdana", bold=bool_3, size="10", content=get_string_6, pl=area_2.Centroid)  # -> out, A; inputs face: String, bold: Boolean, italics: Boolean, size: Double, content: String, pl: Plane; same code as c_script

get_string_7 = GetString(split_list_3.ListA, AtLeast=1, AtMost=2147483647)
c_script_8 = CSharpScript(face="Verdana", bold=bool_3, size="10", content=get_string_7, pl=move_3.Geometry)  # -> out, A; inputs face: String, bold: Boolean, italics: Boolean, size: Double, content: String, pl: Plane; same code as c_script
c_script_9 = CSharpScript(crv=[c_script_8.A, c_script_7.A], color=ColourSwatch(SwatchColor=RGB(0, 0, 0)))  # -> out, A; inputs crv: Curve, color: Color; same code as c_script_6
curve_2 = Curve(c_script_9.A)
merge_2 = Merge(Data1=data, Data2=split_list_2.ListA, Data3=curve_2)
split_list_4 = SplitList(List=merge_2, Index="0")  # -> ListA, ListB
stream_filter_2 = StreamFilter(Gate=gate_not, Stream0=split_list_4.ListA, Stream1=split_list_4.ListB)

# ---- group: RH_OUT:mesh
mesh_3 = Mesh(stream_filter_2)
