# Grasshopper definition EvolvCocoon.gh (Grasshopper 1.0.7)
# plug-ins: MarchingCubes

pt = Point([Point(173.8731635, 75.78794427, 0), Point(-13.8546622, 66.94465686, 0), Point(-6.754873937, -106.1730337, 0), Point(121.5670939, -87.73638639, 0), Point(79.81309992, -23.43908605, 0)])
scale = Panel("0.1")
unit_z = UnitZ(Factor="110")
points = GetPoint(pt, AtLeast=1, AtMost=2147483647, Realtime=True)
dimension = GetNumber(Slider(800, range=350..1000), AtLeast=1, AtMost=2147483647, Maximum=1.797693135e+308, Minimum=-1.797693135e+308)
move = Move(Geometry=points, Motion=unit_z)  # -> Geometry, Transform
dom = ConstructDomain(DomainStart=expr("-x/2", dimension), DomainEnd=expr("x/2", dimension))
rectangle = Rectangle(Plane=PlaneXY(0, 0, 0), XSize=dom, YSize=dom, Radius=0)  # -> Rectangle, Length

list_item = ListItem(List=move.Geometry, Index=0, Wrap=True)  # -> Item, Item1, Item2, Item3, Item4
pt_2 = Point(list_item.Item1)
pt_3 = Point(list_item.Item)
pt_4 = Point(list_item.Item2)
pt_5 = Point(list_item.Item3)
pt_6 = Point(list_item.Item4)
get_string = GetString("POINT 1", AtLeast=1, AtMost=2147483647)
get_string_2 = GetString("POINT 2", AtLeast=1, AtMost=2147483647)
get_string_3 = GetString("POINT 3", AtLeast=1, AtMost=2147483647)
get_string_4 = GetString("POINT 4", AtLeast=1, AtMost=2147483647)
get_string_5 = GetString("POINT 5", AtLeast=1, AtMost=2147483647)
bool = Boolean(True)
c_script = CSharpScript(face="Verdana", bold=bool, size="10", content=get_string, pl=pt_3)  # -> out, A; inputs face: String, bold: Boolean, italics: Boolean, size: Double, content: String, pl: Plane
# ---------- c_script: C# usings ----------
using System.IO;
using System.Linq;
using System.Data;
using System.Drawing;
using System.Reflection;
using System.Windows.Forms;
using System.Xml;
using System.Xml.Linq;
using System.Runtime.InteropServices;

using Rhino.DocObjects;
using Rhino.Collections;
using GH_IO;
using GH_IO.Serialization;
# ---------- c_script: C# ----------
    if(size == 0)
      size = 1;

    if(!string.IsNullOrEmpty(face) && size > 0 && !string.IsNullOrEmpty(content) &&
      pl.IsValid)
    {
      using (var doc = Rhino.RhinoDoc.CreateHeadless(null))
      {
        var te = doc.Objects.AddText(content, pl, size, face, bold, italics);
        var txt = doc.Objects.Find(te) as Rhino.DocObjects.TextObject;

        if(txt != null)
        {
          var tt = txt.Geometry as Rhino.Geometry.TextEntity;
          A = tt.Explode();
        }
      }
    }
# ---------- end c_script ----------
c_script_2 = CSharpScript(face="Verdana", bold=bool, size="10", content=get_string_2, pl=pt_2)  # -> out, A; inputs face: String, bold: Boolean, italics: Boolean, size: Double, content: String, pl: Plane; same code as c_script
c_script_3 = CSharpScript(face="Verdana", bold=bool, size="10", content=get_string_3, pl=pt_4)  # -> out, A; inputs face: String, bold: Boolean, italics: Boolean, size: Double, content: String, pl: Plane; same code as c_script
c_script_4 = CSharpScript(face="Verdana", bold=bool, size="10", content=get_string_4, pl=pt_5)  # -> out, A; inputs face: String, bold: Boolean, italics: Boolean, size: Double, content: String, pl: Plane; same code as c_script
c_script_5 = CSharpScript(face="Verdana", bold=bool, size="10", content=get_string_5, pl=pt_6)  # -> out, A; inputs face: String, bold: Boolean, italics: Boolean, size: Double, content: String, pl: Plane; same code as c_script

# ---- group: RH_IN:SUNLIGHT ANALYSIS
bool_2 = Boolean(False)

# ---- group: RH_OUT:limit
crv = Curve(rectangle.Rectangle)

# ----
sp_radius2 = GetNumber(Slider(25, range=25..100), AtLeast=1, AtMost=2147483647, Maximum=1.797693135e+308, Minimum=-1.797693135e+308)
sp_radius3 = GetNumber(Slider(26, range=25..100), AtLeast=1, AtMost=2147483647, Maximum=1.797693135e+308, Minimum=-1.797693135e+308)
sp_radius1 = GetNumber(Slider(25, range=25..100), AtLeast=1, AtMost=2147483647, Maximum=1.797693135e+308, Minimum=-1.797693135e+308)
sp_radius4 = GetNumber(Slider(25, range=25..100), AtLeast=1, AtMost=2147483647, Maximum=1.797693135e+308, Minimum=-1.797693135e+308)
sp_radius5 = GetNumber(Slider(25, range=25..100), AtLeast=1, AtMost=2147483647, Maximum=1.797693135e+308, Minimum=-1.797693135e+308)
scale_2 = Scale(Geometry=points, Center=Point(0, 0, 0), Factor=scale)  # -> Geometry, Transform

Z = UnitZ(Factor="0")
move_2 = Move(Geometry=rectangle.Rectangle, Motion=Z)  # -> Geometry, Transform
scale_3 = Scale(Geometry=move_2.Geometry, Center=Point(0, 0, 0), Factor=scale)  # -> Geometry, Transform
pop2d = Populate2D(Region=scale_3.Geometry, Count="15", Seed=1)
cp = ClosestPoint(Point=scale_2.Geometry, Cloud=pop2d)  # -> ClosestPoint, CPIndex, Distance

merge = Merge(Data1=sp_radius1, Data2=sp_radius2, Data3=sp_radius3, Data4=sp_radius4, Data5=sp_radius5)

panel = Panel("TEXT TO CURVE")

point_charge = PointCharge(Point=cp.ClosestPoint, Radius=merge, ChargeStrength=1)
boolean_toggle = BooleanToggle(True)
cocoon = Cocoon(Charges=point_charge, Iso="0.02", CellSize="20", Execute=boolean_toggle, Simple=False)  # -> Mesh, RefinementData

# ---- group: RH_OUT:text_lines1
crv_2 = Curve(c_script.A)

# ---- group: RH_OUT:text_lines2
crv_3 = Curve(c_script_2.A)

# ---- group: RH_OUT:text_lines3
crv_4 = Curve(c_script_3.A)

# ---- group: RH_OUT:text_lines4
crv_5 = Curve(c_script_4.A)

# ---- group: RH_OUT:text_lines5
crv_6 = Curve(c_script_5.A)

# ----
panel_2 = Panel("GENERATE COCOON")
multiplication = Multiplication(A="20", B="3")
refine = Refine(
    RefinementData=cocoon.RefinementData,
    Samples=multiplication,
    SampleSize="30",
    SampleTolerance="0.01",
    LaplacianSmoothing="10",
    ValencePasses="10",
    SubD="1",
    Execute=boolean_toggle)

mesh = Mesh(refine)
box = Box(mesh)
deconstruct_brep = DeconstructBrep(Brep=box)  # -> Faces, Edges, Vertices
list_item_2 = ListItem(List=reverse(deconstruct_brep.Faces), Index=0, Wrap=True)
list_item_3 = ListItem(List=reverse(deconstruct_brep.Edges), Index=0, Wrap=True)
length = Length(Curve=list_item_3)
# CUTTING SPHERE IN HALF
division = Division(A=length, B=2)
unit_z_2 = UnitZ(Factor=division)
negative = Negative(Value=unit_z_2)
unit_z_3 = UnitZ(Factor="50")
move_3 = Move(Geometry=list_item_2, Motion=negative)  # -> Geometry, Transform

mesh_split_plane = MeshSplitPlane(Mesh=mesh, Plane=move_3.Geometry)  # -> Above, Below

scale_4 = Scale(Geometry=mesh_split_plane.Above, Center=Point(0, 0, 0), Factor="3")  # -> Geometry, Transform

face_boundaries = FaceBoundaries(Mesh=scale_4.Geometry)

crv_7 = Curve(simplify(face_boundaries))
midpt = CurveMiddle(Curve=crv_7)
pdecon = Deconstruct(Point=midpt)  # -> XComponent, YComponent, ZComponent
bnd = Bounds(Numbers=pdecon.ZComponent)
dedomain = DeconstructDomain(Domain=bnd)  # -> Start, End
gradient = Gradient(
    LowerLimit=0,
    UpperLimit=dedomain.End,
    Parameter=pdecon.ZComponent,
    stops=[0.125: RGB(0, 0, 0), 0.499: RGB(154, 205, 50), 0.926: RGB(220, 20, 60)])
c_script_6 = CSharpScript(crv=crv_7, color=gradient)  # -> out, A; inputs crv: Curve, color: Color
# ---------- c_script_6: C# ----------
    var c = color.R + "," + color.G + "," + color.B;
    crv.SetUserString("color", c);
    A = crv;
# ---------- end c_script_6 ----------
preview = CustomPreview(Geometry=crv_7, Material=gradient)

function_1 = Panel("OUTPUT COLORED CURVE ")
curve = Curve(c_script_6.A)

# ---- group: RH_OUT:crvs
crv_8 = Curve(curve)
