# Grasshopper definition ExplodeRoof.gh (Grasshopper 1.0.7)

# ---- group: RH_IN:Distance
number_slider = Slider(5, range=0..50)

# ---- group: RH_IN:Ucount
ucount = Slider(5, range=2..15)

# ---- group: RH_IN:Vcount
vcount = Slider(2, range=2..10)

# ---- group: RH_IN:explode
bool = Boolean(False)

# ----
construct_domain² = ConstructDomain²(UMin=0, UMax=1, VMin=0, VMax=1)
range = Range(Domain=Domain(0, 1), Steps=ucount)
range_2 = Range(Domain=Domain(0, 1), Steps=vcount)
construct_point = ConstructPoint(XCoordinate=range, YCoordinate=range_2, ZCoordinate=0)
surface = Surface(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)
divide_domain² = DivideDomain²(Domain=construct_domain², UCount=ucount, VCount=vcount)
iso_curve = IsoCurve(Surface=reparameterize(surface), UVPoint=construct_point)  # -> UIsocurve, VIsocurve
isotrim = Isotrim(Surface=reparameterize(surface), Domain=divide_domain²)
unit_z = UnitZ(Factor=expr("-x", Slider(1, range=0..1000)))
deconstruct_brep = DeconstructBrep(Brep=isotrim)  # -> Faces, Edges, Vertices
curve = Curve(iso_curve.UIsocurve)
curve_2 = Curve(iso_curve.VIsocurve)
extrude = Extrude(Base=curve, Direction=unit_z)
extrude_2 = Extrude(Base=curve_2, Direction=unit_z)
number_slider_2 = Slider(0.25, range=0..1)
list_item = ListItem(List=deconstruct_brep.Vertices, Index=0, Wrap=True)
list_item_2 = ListItem(List=deconstruct_brep.Vertices, Index=2, Wrap=True)
list_item_3 = ListItem(List=deconstruct_brep.Vertices, Index=1, Wrap=True)
list_item_4 = ListItem(List=deconstruct_brep.Vertices, Index=3, Wrap=True)
surface_2 = Surface([extrude, extrude_2])
line = Line(StartPoint=list_item, EndPoint=list_item_2)
line_2 = Line(StartPoint=list_item_3, EndPoint=list_item_4)
unit_x = UnitX(Factor=expr("-x", number_slider_2))
unit_x_2 = UnitX(Factor=number_slider_2)
pull_curve = PullCurve(Curve=[line, line_2], Surface=deconstruct_brep.Faces)
extrude_3 = Extrude(Base=surface_2, Direction=unit_x_2)
extrude_4 = Extrude(Base=surface_2, Direction=unit_x)
merge = Merge(Data1=extrude_3, Data2=extrude_4)
unit_z_2 = UnitZ(Factor=Slider(0, range=-1000..3000))
move = Move(Geometry=pull_curve, Motion=unit_z_2)  # -> Geometry, Transform
pipe = Pipe(Curve=move.Geometry, Radius=Slider(0.1, range=0..0.1), Caps=0)

custom_preview = CustomPreview(Geometry=isotrim, Material=ColourSwatch(SwatchColor=RGB(255, 255, 255)))

custom_preview_2 = CustomPreview(Geometry=merge, Material=ColourSwatch(SwatchColor=RGB(200, 111, 97)))

custom_preview_3 = CustomPreview(Geometry=pipe, Material=ColourSwatch(SwatchColor=RGB(18, 3, 3)))

mesh = MeshBrep(
    Brep=pipe,
    Settings={GridMaxCount=0, GridMinCount=16, JaggedSeams=False, MaxEdgeLength=0, MinEdgeLength=0.0001, MinTolerance=0, Refine=True, RefineAngle=0, RelativeTolerance=0.65, SimplePlanes=True, Tolerance=0})
mesh_2 = MeshBrep(
    Brep=merge,
    Settings={GridMaxCount=0, GridMinCount=16, JaggedSeams=False, MaxEdgeLength=0, MinEdgeLength=0.0001, MinTolerance=0, Refine=True, RefineAngle=0, RelativeTolerance=0.65, SimplePlanes=True, Tolerance=0})
bbox = BoundingBox(Content=isotrim, Plane=PlaneXY(0, 0, 0), UnionBox=True)  # -> Box, Box_2

volume = Volume(Geometry=bbox.Box)  # -> Volume, Centroid
moveaway = MoveAwayFrom(Geometry=[mesh, mesh_2], Emitter=volume.Centroid, Distance=number_slider)  # -> Geometry, Transform
mjoin = MeshJoin(Meshes=moveaway.Geometry)

mesh_join = MeshJoin(Meshes=[mesh, mesh_2])
mesh_brep = MeshBrep(
    Brep=isotrim,
    Settings={GridMaxCount=0, GridMinCount=16, JaggedSeams=False, MaxEdgeLength=0, MinEdgeLength=0.0001, MinTolerance=0, Refine=True, RefineAngle=0, RelativeTolerance=0.65, SimplePlanes=True, Tolerance=0})
filter = StreamFilter(Gate=bool, Stream0=mesh_join, Stream1=mjoin)

# ---- group: RH_OUT:mesh
mesh_3 = Mesh([filter, mesh_brep])
