# Grasshopper definition _direct_sun_study.gh (Grasshopper 1.0.7)

# ----
# Import Location from EPW File
panel = Panel("http://climate.onebuilding.org/WMO_Region_4_North_and_Central_America/USA_United_States_of_America/WI_Wisconsin/USA_WI_Madison-Dane.County.Rgnl.AP-Truax.Field.726410_TMY3.zip")
downloadepw = LBDownloadWeather(weather_URL=panel)  # -> epw_file, stat_file, ddy_file; plug-in component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
importloc = LBImportLocation(epw_file=downloadepw.epw_file)  # -> location; plug-in component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

# ---- group: RH_IN:move_x
number_slider = Slider(4, range=1..10)

# ---- group: RH_IN:move_y
# Make "context" dynamic to make
# Rhino.Compute example more interesting!
number_slider_2 = Slider(6, range=1..10)

# ---- group: RH_IN:height
number_slider_3 = Slider(1, range=1..10)

# ----
# Analysis Period for
# Summer Solstice
panel_2 = Panel("6")
analysisperiod = LBAnalysisPeriod(start_month=panel_2, start_day="21", start_hour=0, end_month=panel_2, end_day="21", timestep="4")  # -> period, hoys, dates; plug-in component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

brep = Brep(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)
scale_nu = ScaleNU(Geometry=brep, Plane=PlaneXY(0, 0, 0), ScaleX=1, ScaleY=1, ScaleZ=number_slider_3)  # -> Geometry, Transform
vec = VectorXYZ(XComponent=number_slider, YComponent=number_slider_2, ZComponent=0)  # -> Vector, Length
move = Move(Geometry=scale_nu.Geometry, Motion=vec.Vector)  # -> Geometry, Transform

# ----
# Create Sunpath
panel_3 = Panel("20")
sunpath = LBSunPath(north=panel_3, location=importloc, hoys=analysisperiod.hoys, scale=1)  # -> report, vectors, altitudes, azimuths, hoys, sun_pts, analemma, daily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; plug-in component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

srf = Surface(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)

# ---- group: Run Me!
toggle = BooleanToggle(True)

# ----
# Run Direct Sun Study
geo = Geometry(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)  # disabled
geo_2 = Geometry(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)  # disabled
directsunhours = LBDirectSunHours(
    vectors=flatten(sunpath.vectors),
    timestep="4",
    geometry=flatten(srf),
    context=flatten(move.Geometry),
    grid_size="1",
    offset_dist="0.1",
    run=toggle)  # -> report, points, results, mesh, legend, title, int_mtx; plug-in component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

# ---- group: RH_OUT:mesh
mesh = Mesh(directsunhours.mesh)
