# Grasshopper definition metaballTable2.gh (Grasshopper 1.0.7)
# plug-ins: MarchingCubes, Pufferfish, Heliotrope

scale = Panel("0.1")
point = Point([Point(-597.8533102, 724.8255239, 0), Point(-340.8840249, -323.7513882, 0), Point(589.42571, -349.3185505, 0), Point(414.862267, 864.8172023, 0), Point(58.64608119, 208.7808513, 0)])
height = GetNumber(Slider(350, range=350..1000), AtLeast=1, AtMost=2147483647, Maximum=1.797693135e+308, Minimum=-1.797693135e+308)
points = GetPoint(point, AtLeast=1, AtMost=2147483647, Realtime=True)
dimension = GetNumber(Slider(800, range=350..1000), AtLeast=1, AtMost=2147483647, Maximum=1.797693135e+308, Minimum=-1.797693135e+308)
dom = ConstructDomain(DomainStart=expr("-x/2", dimension), DomainEnd=expr("x/2", dimension))
Z = UnitZ(Factor=height)
rectangle = Rectangle(Plane=PlaneXY(0, 0, 0), XSize=dom, YSize=dom, Radius=0)  # -> Rectangle, Length
move = Move(Geometry=rectangle.Rectangle, Motion=Z)  # -> Geometry, Transform

# ---- group: RH_OUT:limit
crv = Curve(rectangle.Rectangle)

# ----
scale_2 = Scale(Geometry=points, Center=Point(0, 0, 0), Factor=scale)  # -> Geometry, Transform
scale_3 = Scale(Geometry=move.Geometry, Center=Point(0, 0, 0), Factor=scale)  # -> Geometry, Transform
sp_radius2 = GetNumber(Slider(6, range=0..60), AtLeast=1, AtMost=2147483647, Maximum=1.797693135e+308, Minimum=-1.797693135e+308)
sp_radius3 = GetNumber(Slider(7, range=0..60), AtLeast=1, AtMost=2147483647, Maximum=1.797693135e+308, Minimum=-1.797693135e+308)
sp_radius1 = GetNumber(Slider(9, range=0..60), AtLeast=1, AtMost=2147483647, Maximum=1.797693135e+308, Minimum=-1.797693135e+308)
sp_radius4 = GetNumber(Slider(4, range=0..60), AtLeast=1, AtMost=2147483647, Maximum=1.797693135e+308, Minimum=-1.797693135e+308)
sp_radius5 = GetNumber(Slider(4, range=0..60), AtLeast=1, AtMost=2147483647, Maximum=1.797693135e+308, Minimum=-1.797693135e+308)
pop2d = Populate2D(Region=scale_3.Geometry, Count="10", Seed=1)
merge = Merge(Data1=sp_radius1, Data2=sp_radius2, Data3=sp_radius3, Data4=sp_radius4, Data5=sp_radius5)
cp = ClosestPoint(Point=scale_2.Geometry, Cloud=pop2d)  # -> ClosestPoint, CPIndex, Distance
point_charge = PointCharge(Point=cp.ClosestPoint, Radius=merge, ChargeStrength=1)
boolean_toggle = BooleanToggle(True)
cocoon = Cocoon(Charges=point_charge, Iso="0.17", CellSize="10", Execute=boolean_toggle, Simple=False)  # -> Mesh, RefinementData
multiplication = Multiplication(A="10", B="0.8")
refine = Refine(
    RefinementData=cocoon.RefinementData,
    Samples=multiplication,
    SampleSize="15",
    SampleTolerance="0.01",
    LaplacianSmoothing="10",
    ValencePasses="10",
    SubD="1",
    Execute=boolean_toggle)
mesh = Mesh(refine)
box = Box(mesh)
deconstruct_brep = DeconstructBrep(Brep=box)  # -> Faces, Edges, Vertices
list_item = ListItem(List=reverse(deconstruct_brep.Faces), Index=0, Wrap=True)
list_item_2 = ListItem(List=reverse(deconstruct_brep.Edges), Index=0, Wrap=True)
length = Length(Curve=list_item_2)
division = Division(A=length, B=2)
unit_z = UnitZ(Factor=division)
negative = Negative(Value=unit_z)
unit_z_2 = UnitZ(Factor="50")
move_2 = Move(Geometry=list_item, Motion=negative)  # -> Geometry, Transform
offset_mesh = OffsetMesh(Mesh=move_2.Geometry, Distance=expr("-x", unit_z_2), BothSides=False, CreateSolid=True)
mesh_split = MeshSplit(Mesh=mesh, Splitters=offset_mesh)
list_item_3 = ListItem(List=mesh_split, Index=0, Wrap=True)  # -> Item, Item1

# ---- group: RH_OUT:mesh
mesh_2 = Mesh(list_item_3.Item1)

# ----
face_boundaries = FaceBoundaries(Mesh=mesh_2)
scale_4 = Scale(Geometry=face_boundaries, Center=Point(0, 0, 0), Factor="3")  # -> Geometry, Transform
boundary_surfaces = BoundarySurfaces(Edges=face_boundaries)

crv_2 = Curve(simplify(scale_4.Geometry))
midpt = CurveMiddle(Curve=crv_2)
pdecon = Deconstruct(Point=midpt)  # -> XComponent, YComponent, ZComponent
bnd = Bounds(Numbers=pdecon.ZComponent)
dedomain = DeconstructDomain(Domain=bnd)  # -> Start, End
gradient = Gradient(
    LowerLimit=0,
    UpperLimit=dedomain.End,
    Parameter=pdecon.ZComponent,
    stops=[0.125: RGB(0, 0, 0), 0.499: RGB(154, 205, 50), 0.926: RGB(220, 20, 60)])
c_script = CSharpScript(crv=crv_2, color=gradient)  # -> out, A; inputs crv: Curve, color: Color
# ---------- c_script: C# ----------
    var c = color.R + "," + color.G + "," + color.B;
    crv.SetUserString("color", c);
    A = crv;
# ---------- end c_script ----------
preview = CustomPreview(Geometry=crv_2, Material=gradient)

surface = Surface(boundary_surfaces)
number_slider = Slider(360, range=0..1000)

# ---- group: RH_OUT:crvs
crv_3 = Curve(c_script.A)

# ----
sun_orientation = Slider(0.44, range=0..1)

# ----
# Sun path
number_slider_2 = Slider(52, range=0..100)
bounding_box = BoundingBox(Content=flatten(surface), Plane=PlaneXY(0, 0, 0), UnionBox=True)  # -> Box, Box_2
area = Area(Geometry=bounding_box.Box)  # -> Area, Centroid
number_slider_3 = Slider(30, range=0..100)  # disabled
unit_z_3 = UnitZ(Factor=Slider(10, range=0..10))
move_3 = Move(Geometry=area.Centroid, Motion=unit_z_3)  # -> Geometry, Transform
solar_arc = SolarArc(
    JulianDay=number_slider_2,
    Latitude=Slider(100, range=0..100),
    Longitude=Slider(100, range=0..100),
    North=Vector(0, 1, 0),
    Origin=move_3.Geometry,
    ScaleArc=Slider(50, range=0..500),
    ScaleSun=Slider(1, range=0.5..5),
    Offset=sun_orientation)  # -> SolarArc, Sun, SolarVector, TimeOfDay
deconstruct_vector = DeconstructVector(Vector=move_3.Geometry)  # -> XComponent, YComponent, ZComponent
vector_xyz = VectorXYZ(XComponent=deconstruct_vector.XComponent, YComponent=deconstruct_vector.YComponent, ZComponent=0)  # -> Vector, Length
unit_z_4 = UnitZ(Factor=vector_xyz.Vector)  # disabled
unit_x = UnitX(Factor=vector_xyz.Vector)

# ---- group: pOINT ATTRACTOR
# Points Attractor BY SUN
md_slider = MDSlider(SliderMode=0, slider_value=Point(0.5, 0.5, 0.5), x_domain=Domain(0, 1), y_domain=Domain(0, 1), z_domain=Domain(0, 1))
evaluate_surface = EvaluateSurface(Surface=reparameterize(surface), Point=md_slider)  # -> Point, Normal, UDirection, VDirection, Frame
volume = Volume(Geometry=solar_arc.Sun)  # -> Volume, Centroid
line = Line(StartPoint=evaluate_surface.Point, EndPoint=volume.Centroid)
line_sdl = LineSDL(Start=evaluate_surface.Point, Direction=evaluate_surface.Normal, Length=Slider(2, range=0..10))
area_2 = Area(Geometry=surface)  # -> Area, Centroid; disabled
curve = Curve(surface)  # disabled

# ---- group: pOINT ATTRACTOR / LENGTH PARAMETRIC
length_2 = Length(Curve=line)  # disabled
remap = Remap(data=length_2, min=0, max=1)  # disabled
number_slider_4 = Slider(0.4, range=0..1)  # disabled
number_slider_5 = Slider(1.2, range=0..1.2)  # disabled
graph_mapper = GraphMapper(
    remap,
    x0=0,
    x1=1,
    y0=0,
    y1=1,
    container_name="Bezier",
    cpx=[0, 0.2365545779, 0.8001514673, 1],
    cpy=[0.01750952005, 0.9864675403, 0, 0.9973800778])  # disabled
remap_2 = Remap(data=graph_mapper, min=number_slider_4, max=number_slider_5)  # disabled
scale_5 = Scale(Geometry=curve, Center=area_2.Centroid, Factor=remap_2)  # -> Geometry, Transform; disabled
boundary_surfaces_2 = BoundarySurfaces(Edges=scale_5.Geometry)  # disabled

# ---- group: pOINT ATTRACTOR
angle = Angle(VectorA=line_sdl, VectorB=line)  # -> Angle, Reflex
bounds = Bounds(Numbers=angle.Angle)
deconstruct_domain = DeconstructDomain(Domain=bounds)  # -> Start, End
gradient_2 = Gradient(
    LowerLimit=deconstruct_domain.Start,
    UpperLimit=deconstruct_domain.End,
    Parameter=angle.Angle,
    stops=[0: RGB(0, 128, 0), 0.5: RGB(255, 255, 0), 1: RGB(255, 0, 0)])

# ----
custom_preview = CustomPreview(Geometry=surface, Material=gradient_2)

evaluate_surface_2 = EvaluateSurface(Surface=reparameterize(surface), Point=unit_x)  # -> Point, Normal, UDirection, VDirection, Frame
point_2 = Point(move_3.Geometry)
area_3 = Area(Geometry=surface)  # -> Area, Centroid
curve_2 = Curve(surface)
closest_point = ClosestPoint(Point=area_3.Centroid, Cloud=point_2)  # -> ClosestPoint, CPIndex, Distance
remap_3 = Remap(data=closest_point.Distance, min=0, max=1)
graph_mapper_2 = GraphMapper(remap_3, x0=0, x1=1, y0=0, y1=1, Ox=1, Oy=1, Px=0, Py=0, container_name="Parabola")
remap_4 = Remap(data=graph_mapper_2, min=Slider(0.6, range=0..1), max=Slider(1, range=0..1))
scale_6 = Scale(Geometry=curve_2, Center=area_3.Centroid, Factor=remap_4)  # -> Geometry, Transform
boundary_surfaces_3 = BoundarySurfaces(Edges=scale_6.Geometry)

surface_2 = Surface(boundary_surfaces_3)

# ==== cluster Remap: Remaps numbers
data = ClusterInput()
min = ClusterInput()
max = ClusterInput()
bnd = Bounds(Numbers=data)
dom = ConstructDomain(DomainStart=min, DomainEnd=max)
remap = RemapNumbers(Value=data, Source=bnd, Target=dom)  # -> Mapped, Clipped
R = ClusterOutput(remap.Mapped)
